# Grasshopper definition BranchNodeRnd.ghx (Grasshopper 1.0.7)

# ---- group: RH_IN:201:Length
branch_length = Slider(10, range=0..10)

# ---- group: RH_IN:201:Radius
cell_radius = Slider(10, range=0..10)

# ---- group: RH_IN:201:Count
number_slider = Slider(35, range=1..100)

# ----
sph = Sphere(Base=PlaneXY(0, 0, 0), Radius=cell_radius)
popgeo = PopulateGeometry(Geometry=sph, Count=number_slider, Seed=1)
facet = FacetDome(Points=popgeo, Radius=cell_radius)  # -> Pattern, Dome
boundary = BoundarySurfaces(Edges=facet.Pattern)
pt = ConstructPoint(XCoordinate="0.5", YCoordinate="0.5", ZCoordinate=0)
evalsrf = EvaluateSurface(Surface=reparameterize(boundary), Point=pt)  # -> Point, Normal, UDirection, VDirection, Frame
deplane = DeconstructPlane(Plane=evalsrf.Frame)  # -> Origin, XAxis, YAxis, ZAxis
amp = Amplitude(Vector=deplane.ZAxis, Amplitude=branch_length)
move = Move(Geometry=facet.Pattern, Motion=amp)  # -> Geometry, Transform
cp = ControlPoints(Curve=move.Geometry)  # -> Points, Weights, Knots
explode = Explode(Curve=facet.Pattern, Recursive=True)  # -> graft(Segments), Vertices
explode_2 = Explode(Curve=move.Geometry, Recursive=True)  # -> graft(Segments), Vertices
shift = ShiftList(List=cp.Points, Shift=1, Wrap=invert(True))
del = DelaunayMesh(Points=shift, Plane=PlaneXY(0, 0, 0))
end = EndPoints(Curve=explode.Segments)  # -> Start, End
end_2 = EndPoints(Curve=explode_2.Segments)  # -> Start, End
merge = Merge(Data1=end.Start, Data2=end_2.Start, Data3=end_2.End, Data4=end.End)
quad = Quadrangulate(Mesh=del, Angle=Slider(1, range=0..1), Ratio=Slider(0, range=0..1))  # -> flatten(Mesh), Count
conmesh = ConstructMesh(Vertices=merge, Faces={A=0, B=1, C=2, D=3})
mjoin = MeshJoin(Meshes=flatten(conmesh))
alignvert = AlignVertices(Mesh=mjoin, Tolerance=0.1)  # -> Result, Count
weld = WeldMesh(Mesh=alignvert.Result, Angle=3.141592654)
mesh = Mesh(quad.Mesh)
mjoin_2 = MeshJoin(Meshes=flatten([weld, mesh]))
alignvert_2 = AlignVertices(Mesh=mjoin_2, Tolerance=0.1)  # -> Result, Count
weld_2 = WeldMesh(Mesh=alignvert_2.Result, Angle=3.141592654)
c_script = CSharpScript(m=weld_2)  # -> out, A; inputs m: Mesh
# ---------- c_script: C# ----------
    var subD = Rhino.Geometry.SubD.CreateFromMesh(m);
    var brep = subD.ToBrep();
    var mesh = new Mesh();
    mesh.Append(Mesh.CreateFromBrep(brep, MeshingParameters.Default));
    mesh.Flip(true, true, true);
    A = mesh;
# ---------- end c_script ----------

# ---- group: RH_OUT:115:Mesh
mesh_2 = Mesh(c_script.A)

# ----
alignvert_3 = AlignVertices(Mesh=mesh_2, Tolerance=0.1)  # -> Result, Count
preview = CustomPreview(Geometry=mesh_2, Material=ColourSwatch(SwatchColor=RGB(255, 255, 255)))
weld_3 = WeldMesh(Mesh=alignvert_3.Result, Angle=3.141592654)
